# Grasshopper definition api.ghx (Grasshopper 1.0.7)
# plug-ins: Hops

local_hops = Panel("http://localhost:5000/")
# deploy app: http://mmodel.contextmachine.online:8088/
# deploy hops: http://mmodel.contextmachine.online:5000/
local_app = Panel("http://localhost:8080/")
application_json = Panel("{\"kwargs\":{\"key\": \"all\",\"num\": 1000.0}}")
concat = Concatenate(FragmentC=local_app, FragmentA="site/kommunarka/")
concat_2 = Concatenate(FragmentC=local_app, FragmentA="site/kommunarka/")
hops = Hops(
    Run=Toggle(True),
    Url=concat,
    Name="polygon_coords",
    CacheResultsInMemory=False,
    CacheSolveResults=False,
    RemoteDefinitionLocation="http://127.0.0.1:5000/GET",
    RemoteSolveVersion=(0, 1, 0),
    ShowInput_Enabled=False,
    ShowInput_Path=False,
    SynchronousSolve=True)
hops_2 = Hops(
    Run=Toggle(True),
    Url=concat,
    Name="network_edges_coords",
    Data=application_json,
    CacheResultsInMemory=False,
    CacheSolveResults=False,
    RemoteDefinitionLocation="http://127.0.0.1:5000/POST",
    RemoteSolveVersion=(0, 1, 0),
    ShowInput_Enabled=False,
    ShowInput_Path=False,
    SynchronousSolve=False)
python = GhPythonScript(x=hops_2, y="network_edges_coords")  # -> out, a
# ---------- python: Python ----------
__author__ = "andrewastakhov"
import json

import rhinoscriptsyntax as rs
from Rhino.Geometry import Point3d, Polyline
from ghpythonlib.treehelpers import list_to_tree
def decode_pts(arr):
    for pt in arr:
        pt.append(0.0)
        yield Point3d(*pt)

def decode_lines(arr):
    for ln in arr:
        yield Polyline(list(decode_pts(ln)))


a = list_to_tree(
    list(
        decode_lines(
            json.loads(x)[y]
        )
    )
)
# ---------- end python ----------
python_2 = GhPythonScript(x=hops, y="polygon_coords")  # -> out, a
# ---------- python_2: Python ----------
__author__ = "andrewastakhov"
import json

import rhinoscriptsyntax as rs
from Rhino.Geometry import Point2d
from ghpythonlib.treehelpers import list_to_tree

def decode_pts(arr):
    for pt in arr:
        yield Point2d(*pt)


a = list_to_tree(
    list(
        decode_pts(
            json.loads(x)[y]
        )
    )
)
# ---------- end python_2 ----------
pline = PolyLine(Vertices=python.a, Closed=False)
pt = Point(python_2.a)
pline_2 = PolyLine(Vertices=pt, Closed=False)
